# Grasshopper definition LARCH7031_WORKSHOP_BASIC_OPERATIONS_00.gh (Grasshopper 1.0.7)
# plug-ins: Docofossor

path = FilePath("E:\UniAdelaide\Landscape Arch\DTMs_for_lessons\DTMs_for_lessons\DTM_Lessons_ASCII-2.asc")
# MODIFYING WITH CURVES
crv = Curve(<curve referenced from the Rhino model>)

crv_2 = Curve(<curve referenced from the Rhino model>)
crv_3 = Curve(<curve referenced from the Rhino model>)
crv_4 = Curve(<curve referenced from the Rhino model>)
number_slider = Slider(65, range=0..100)
dffillonpath = FillOnPath(
    Crv=crv,
    Mxh=Slider(50, range=0..100),
    Wt=Slider(2, range=0..50),
    Sa=Slider(35, range=0..100),
    D=Slider(100, range=0..100))  # -> Df, Vol
dfcutonpath = CutOnPath(
    Crv=crv_2,
    Mxd=Slider(15, range=0..100),
    Wb=Slider(5, range=0..10),
    Sa=Slider(55, range=0..100),
    D=Slider(100, range=0..100))  # -> Df, Vol
dffillinpath = FillInPath(Crv=crv_4, Wt=Slider(2, range=0..10), Sa=Slider(55, range=0..100), D=Slider(100, range=0..100))  # -> Df, Vol
dfcutinpath = CutInPath(Crv=crv_2, Wb=Slider(2, range=0..10), Sa=Slider(55, range=0..100), D=Slider(100, range=0..100))  # -> Df, Vol
dfcutfillinpath = CutFillInPath(Crv=crv_3, W=Slider(2, range=0..10), Sa=Slider(45, range=0..100), D=Slider(100, range=0..100))  # -> Df, Vol
dfgridmesh = GridMesh(Df=dffillonpath.Df)
dfgridmesh_2 = GridMesh(Df=dffillinpath.Df)
dfgridmesh_3 = GridMesh(Df=dfcutonpath.Df)
dfgridmesh_4 = GridMesh(Df=dfcutinpath.Df)
dfgridmesh_5 = GridMesh(Df=dfcutfillinpath.Df)

dfimportasc = ImportASC(F=path)
dfgridshift = GridShift(Df=dfimportasc)
dfgridmesh_6 = GridMesh(Df=dfgridshift)
medges = MeshEdges(Mesh=dfgridmesh_6)  # -> NakedEdges, InteriorEdges, NonManifoldEdges
crv_5 = Curve(medges.NakedEdges)
preview = CustomPreview(Geometry=dfgridmesh_6, Material=ColourSwatch(SwatchColor=RGB(204, 199, 159)))
join = JoinCurves(Curves=crv_5, Preserve=False)
project = Project(Geometry=join, Plane=PlaneXY(0, 0, 0))  # -> Geometry, Transform
redpline = Reduce(Polyline=project.Geometry, Tolerance=1)  # -> Polyline, Reduction

# ----
# MODIFYING WITH POINTS
pt = Point([Point(674.4367088, 1820.679059, 153.8259852), Point(801.7500793, 1925.913631, 130.7586959), Point(834.6358829, 1777.384682, 204.1018734)])
pt_2 = Point([Point(193.6711769, 1571.835509, 38.38011333), Point(102.5305211, 1466.600938, 64.14819431), Point(239.711302, 1434.654728, 0)])
dffillonpoint = FillOnPoint(Pt=pt, Mxh=Slider(30, range=0..100), Sa=Slider(33, range=0..100))  # -> Df, Vol
dfcutonpoint = CutOnPoint(Pt=pt_2, Mxd=Slider(30, range=0..100), Sa=Slider(35, range=0..100))  # -> Df, Vol
dffillinpoint = FillInPoint(Pt=pt, Sa=Slider(45, range=0..100), D=Slider(100, range=0..100))  # -> Df, Vol
dfcutinpoint = CutInPoint(Pt=pt_2, Sa=Slider(35, range=0..100), D=Slider(100, range=0..100))  # -> Df, Vol
dfgridmesh_7 = GridMesh(Df=dffillonpoint.Df)
dfgridmesh_8 = GridMesh(Df=dffillinpoint.Df)
dfgridmesh_9 = GridMesh(Df=dfcutonpoint.Df)
dfgridmesh_10 = GridMesh(Df=dfcutinpoint.Df)

srf = Surface(<surface referenced from the Rhino model>)
# MODIFYING WITH REGION/ SURFACES
crv_6 = Curve(<curve referenced from the Rhino model>)
srf_2 = Surface(<surface referenced from the Rhino model>)
srf_3 = Surface(<surface referenced from the Rhino model>)
dffillonarea = FillOnArea(Crv=crv_6, Mxh=Slider(10, range=0..100), Sa=Slider(35, range=0..100))  # -> Df, Vol
dfcutonarea = CutOnArea(Crv=crv_6, Mxd=Slider(20, range=0..100), Sa=Slider(33, range=0..100))  # -> Df, Vol
dffillinsurface = FillInSurface(Srf=srf, Sa=Slider(35, range=0..100), D=Slider(100, range=0..100))  # -> Df, Vol
dfcutinsurface = CutInSurface(Srf=srf_3, Sa=Slider(45, range=0..100), D=Slider(100, range=0..100))  # -> Df, Vol
dfcutfillinsurface = CutFillInSurface(Srf=srf_2, Sa=Slider(45, range=0..100), D=Slider(100, range=0..100))  # -> Df, Vol
dfgridmesh_11 = GridMesh(Df=dffillonarea.Df)
dfgridmesh_12 = GridMesh(Df=dffillinsurface.Df)
dfgridmesh_13 = GridMesh(Df=dfcutonarea.Df)
dfgridmesh_14 = GridMesh(Df=dfcutfillinsurface.Df)
dfgridmesh_15 = GridMesh(Df=dfcutinsurface.Df)
