# Grasshopper definition LARCH7031_WORKSHOP_LADYBUG_00.gh (Grasshopper 1.0.7)
# plug-ins: Docofossor, Section To XY

path = FilePath("E:\UniAdelaide\Landscape Arch\DTMs_for_lessons\DTMs_for_lessons\DTM_Lessons_ASCII-2.asc")
ladybug = Ladybug_Ladybug()  # -> Vviiiiiiiiiizzz; plug-in component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
dfimportasc = ImportASC(F=path)
dfgridshift = GridShift(Df=dfimportasc)
dfgridmesh = GridMesh(Df=dfgridshift)
cluster = Cluster(mesh=dfgridmesh)
preview = CustomPreview(Geometry=dfgridmesh, Material=ColourSwatch(SwatchColor=RGB(209, 191, 161)))
preview_2 = CustomPreview(Geometry=cluster, Material=ColourSwatch(SwatchColor=RGB(84, 84, 84)))
project = Project(Geometry=dfgridmesh, Plane=PlaneXY(0, 0, 0))  # -> Geometry, Transform
area = Area(Geometry=project.Geometry)  # -> Area, Centroid
# EPW
path_2 = FilePath()
panel = Panel(path_2)
importepw = Ladybug_ImportEpw(epwFile=path_2)  # -> readMe, latitude, location, dryBulbTemperature, dewPointTemperature, relativeHumidity, windSpeed, windDirection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; plug-in component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
# HOURS OF ANALYSIS
number_slider = Slider(6, range=6..20)
number_slider_2 = Slider(8, range=0..10)
series = Series(Start=number_slider, Step=1, Count=Slider(15, range=1..15))
panel_2 = Panel(series)

# ----
# WIND ROSE
windrose = Ladybug_WindRose(
    north=0,
    hourlyWindDirection=importepw.windDirection,
    hourlyWindSpeed=importepw.windSpeed,
    scale=number_slider_2,
    runIt=Toggle(False))  # -> readMe, calmRoseMesh, windRoseMesh, windRoseCrvs, windRoseCenPts, legend, legendBasePts, title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; plug-in component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

# ----
# SUN PATH
sunpath = Ladybug_SunPath(
    location=importepw.location,
    hour=series,
    day=21,
    month=Slider(12, range=1..12),
    timeStep=1,
    centerPt=area.Centroid,
    sunPathScale=number_slider_2,
    dailyOrAnnualSunPath=True)  # -> readMe, sunVectors, sunAltitudes, sunAzimuths, port, sunSpheresMesh, sunPathCrvs, compassCrvs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; plug-in component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

remesh_square = RemeshSquare(Mesh=dfgridmesh, Grid=Slider(6, range=0..10))
gradientlibrary = Ladybug_GradientLibrary(gradIndex=Slider(0, range=0..23))  # -> customColors; plug-in component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
quad = Quadrangulate(Mesh=remesh_square, Angle=0.03490658504, Ratio=0.875)  # -> Mesh, Count
legendpar = Ladybug_LegendParameters(highBound=Slider(13, range=0..100), customColors=flatten(gradientlibrary), legendScale=Slider(0.8, range=0..1))  # -> legendPar; plug-in component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
# SUNLIGHT HOURS ANALYSIS
number_slider_3 = Slider(1, range=0..1)
sunlighthoursanalysis = Ladybug_SunlightHoursAnalysis(
    geometry=flatten(quad.Mesh),
    gridSize=number_slider_3,
    disFromBase=Slider(0.15, range=0..1),
    sunVectors=flatten(sunpath.sunVectors),
    timeStep=1,
    legendPar=flatten(legendpar),
    runIt=Toggle(False))  # -> readMe, contextMesh, analysisMesh, testPts, testVec, port, sunlightHoursResult, sunlightHoursMesh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; plug-in component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

medges = MeshEdges(Mesh=quad.Mesh)  # -> NakedEdges, InteriorEdges, NonManifoldEdges

# ---- group: Context
existing_vegetation = Mesh([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])

# ----
preview_3 = CustomPreview(Geometry=existing_vegetation, Material=ColourSwatch(SwatchColor=RGB(41, 87, 40)))
bnd = Bounds(Numbers=sunlighthoursanalysis.sunlightHoursResult)
mesh = Mesh(sunlighthoursanalysis.sunlightHoursMesh)
panel_3 = Panel(bnd)

# ==== cluster Cluster
mesh = ClusterInput()
mesh_2 = Mesh(mesh)
mc = MeshCorners(Mesh=mesh_2, Angle="2")

medges = MeshEdges(Mesh=mesh_2)  # -> NakedEdges, InteriorEdges, NonManifoldEdges
line = Line(medges.NakedEdges)
Z = UnitZ(Factor=1)
join = JoinCurves(Curves=line, Preserve=False)
neg = Negative(Value=Z)
line_2 = LineSDL(Start=mc, Direction=graft([Z, neg]), Length=Slider(75, range=0..100))  # -> flatten(Line)
join_2 = JoinCurves(Curves=line_2, Preserve=False)
ccx = CurveCurve(CurveA=join, CurveB=join_2)  # -> Points, ParamsA, ParamsB
shatter = Shatter(Curve=join, Parameters=flatten(ccx.ParamsA))
project = Project(Geometry=shatter, Plane=PlaneXY(0, 0, 0))  # -> Geometry, Transform
item = ListItem(List=shatter, Index=0, Wrap=True)  # -> Item, Item1, Item2, Item3
end = EndPoints(Curve=shatter)  # -> Start, End
end_2 = EndPoints(Curve=project.Geometry)  # -> Start, End
ln = Line(StartPoint=end.Start, EndPoint=end_2.Start)
item_2 = ListItem(List=ln, Index=0, Wrap=True)  # -> Item, Item1, Item2, Item3
item_3 = ListItem(List=project.Geometry, Index=0, Wrap=True)  # -> Item, Item1, Item2, Item3
join_3 = JoinCurves(Curves=[item.Item, item_2.Item, item_2.Item1, item_3.Item], Preserve=False)
join_4 = JoinCurves(Curves=[item.Item1, item_2.Item1, item_2.Item2, item_3.Item1], Preserve=False)
join_5 = JoinCurves(Curves=[item.Item2, item_2.Item2, item_2.Item3, item_3.Item2], Preserve=False)
join_6 = JoinCurves(Curves=[item.Item3, item_2.Item3, item_2.Item, item_3.Item3], Preserve=False)
boundary = BoundarySurfaces(Edges=join_3)
boundary_2 = BoundarySurfaces(Edges=join_4)
boundary_3 = BoundarySurfaces(Edges=join_5)
boundary_4 = BoundarySurfaces(Edges=join_6)

merge = Merge(Data1=boundary, Data2=boundary_2, Data3=boundary_3, Data4=boundary_4)
R = ClusterOutput(merge)
