# Grasshopper definition import_urbano.gh (Grasshopper 1.0.7)
# plug-ins: Urbano, Bifocals

# ---- group: Land_Use
# Change the Filepath here
panel = Panel("54H")
path = FilePath("C:\users\klixto\Desktop\LandUse_clipped.shp")
importshp = ImportShapefileFeatures(ShapefilePath=path, Reproject=True, UTMZone=panel)  # -> Points, Metadata, UTMZone, TranslationVector
demeta = DeconstructMetadata(Metadata=importshp.Metadata)  # -> Keys, Values
pline = PolyLine(Vertices=importshp.Points, Closed=False)  # -> flatten(Polyline)

# ---- group: Street_Network
# Change the Filepath here
path_2 = FilePath("C:\users\klixto\Desktop\streetnetwork_clipped.shp")
importshp_2 = ImportShapefileFeatures(ShapefilePath=path_2, Reproject=True, UTMZone=panel, TranslationVector=importshp.TranslationVector)  # -> Points, Metadata, UTMZone, TranslationVector
demeta_2 = DeconstructMetadata(Metadata=importshp_2.Metadata)  # -> Keys, Values
pline_2 = PolyLine(Vertices=importshp_2.Points, Closed=False)

# ---- group: Green_Areas
# Change the Filepath here
path_3 = FilePath("C:\users\klixto\Desktop\Greenspaces_clipped.shp")
importshp_3 = ImportShapefileFeatures(ShapefilePath=path_3, Reproject=True, UTMZone=panel, TranslationVector=importshp.TranslationVector)  # -> Points, Metadata, UTMZone, TranslationVector
demeta_3 = DeconstructMetadata(Metadata=importshp_3.Metadata)  # -> Keys, Values
pline_3 = PolyLine(Vertices=importshp_3.Points, Closed=False)

# ----
panel_2 = Panel(demeta.Keys)

number_slider = Slider(1000, range=0..1000)
Z = UnitZ(Factor=number_slider)
move = Move(Geometry=pline_3, Motion=Z)  # -> Geometry, Transform
boundary = BoundarySurfaces(Edges=move.Geometry)
preview = CustomPreview(Geometry=boundary, Material=ColourSwatch(SwatchColor=RGBA(119, 252, 125, 106)))

multiplication = Multiplication(A=number_slider, B=Slider(2, range=0..10))
Z_2 = UnitZ(Factor=multiplication)
move_2 = Move(Geometry=pline_2, Motion=Z_2)  # -> Geometry, Transform
preview_2 = CustomPreview(Geometry=move_2.Geometry, Material=ColourSwatch(SwatchColor=RGBA(73, 64, 255, 146)))

# ---- group: Cleaning the DataTree
graft = GraftTree(Tree=pline, IncludeEmptyLists=True, IncludeNullItems=True)
clean = CleanTree(RemoveNulls=True, RemoveInvalid=True, RemoveEmpty=Toggle(True), Tree=graft)
tstat = TreeStatistics(Tree=clean)  # -> Paths, Length, Count
branch = TreeBranch(Tree=demeta.Values, Path=tstat.Paths, MaintainPaths=True)

# ----
panel_3 = Panel(demeta.Values)

# ---- group: Number of Dwellings
item = ListItem(List=branch, Index=Slider(0, range=0..100), Wrap=True)  # -> flatten(Item)

# ----
bnd = Bounds(Numbers=item)
dedomain = DeconstructDomain(Domain=bnd)  # -> Start, End
gradient = Gradient(
    LowerLimit=dedomain.End,
    UpperLimit=dedomain.Start,
    Parameter=item,
    stops=[0: RGB(234, 38, 0), 0.25: RGB(234, 126, 0), 0.5: RGB(254, 244, 84), 0.75: RGB(173, 203, 249), 1: RGB(75, 107, 169)])
boundary_2 = BoundarySurfaces(Edges=clean)  # -> simplify(Surfaces)

preview_3 = CustomPreview(Geometry=boundary_2, Material=graft(gradient))
pt = Point(Point(317.5955159, -1090.236664, 0))
legn_set = Legend_Settings_2(
    legend_origen=pt,
    legend_size_x=Slider(1000, range=0..1000),
    legend_size_y=Slider(2000, range=0..10000),
    angle_rotation_legend_degrees=Slider(5, range=0..360),
    legend_offset=Slider(115, range=0..1000),
    list_of_values=item,
    gradient_values=gradient,
    gradient_domain=bnd,
    number_of_divisions=Slider(5, range=0..10),
    domain_int_true_float_false=Toggle(True))  # -> legend_colours_2, legend_tags_2, legend_frame, legend_title_plane
legend = Legend(Colour=legn_set.legend_colours_2, Tags=legn_set.legend_tags_2, Rectangle=legn_set.legend_frame, LegendType=101)
tag = TextTag3D(
    Location=legn_set.legend_title_plane,
    Text="Number of Dwellings",
    Size=Slider(80, range=0..100),
    Colour=ColourSwatch(SwatchColor=RGB(20, 20, 20)),
    Justification=7)

# ==== cluster Legend_Settings_2: A setting component for legend parameters based on a gradient
domain_int_true_float_false = ClusterInput()

# ---- group: Cluster Input
gradient_domain = ClusterInput()

list_of_values = ClusterInput()

gradient_values = ClusterInput()

number_of_divisions = ClusterInput()

angle_rotation_legend_degrees = ClusterInput()

# ----
list_of_values_2 = Number(list_of_values)
gradient_domain_2 = Domain(gradient_domain)
gradient_values_2 = Text(gradient_values)
number_of_divisions_2 = Integer(number_of_divisions)
domain_int_true_float_false_2 = Boolean(domain_int_true_float_false)

# ---- group: Cluster Input
legend_origen = ClusterInput()

legend_offset = ClusterInput()

legend_size_y = ClusterInput()

legend_size_x = ClusterInput()

# ----
lng = ListLength(List=gradient_values_2)
div = DivideDomain(Domain=gradient_domain_2, Count=number_of_divisions_2)
division = Division(A=lng, B=number_of_divisions_2)
sort = SortList(Keys=list_of_values_2, ValuesA=gradient_values_2)  # -> Keys, ValuesA
legend_settings = Legend_Settings(
    legend_origen=legend_origen,
    legend_size_x=legend_size_x,
    legend_size_y=legend_size_y,
    angle_rotation_legend_degrees=angle_rotation_legend_degrees,
    legend_offset=legend_offset)  # -> rectangle_frame_2, legend_title_plane_2
dedomain = DeconstructDomain(Domain=div)  # -> Start, End
partition = PartitionList(List=sort.ValuesA, Size=expr("x+1", division))
int = Integer(dedomain.Start)
int_2 = Integer(dedomain.End)
dom = ConstructDomain(DomainStart=int, DomainEnd=int_2)
domain = Domain(div)
item = ListItem(List=partition, Index="-1", Wrap=True)  # -> flatten(Item)
python = GhPythonScript(x=dom, y=domain, z=domain_int_true_float_false_2)  # -> out, a
# ---------- python: Python ----------
__author__ = "klixto"
__version__ = "2020.03.14"

import rhinoscriptsyntax as rs

if z == True:
    a = x
else:
    a = y
# ---------- end python ----------
legend_colours = Colour(item)
legend_tags = Text(python.a)

# ---- group: Cluster Output
legend_colours_2 = ClusterOutput(legend_colours)

legend_title_plane = ClusterOutput(legend_settings.legend_title_plane_2)

legend_tags_2 = ClusterOutput(legend_tags)

legend_frame = ClusterOutput(legend_settings.rectangle_frame_2)

# ==== cluster Legend_Settings

# ---- group: Cluster Input
legend_origen = ClusterInput()

legend_size_x = ClusterInput()

legend_size_y = ClusterInput()

# ----
legend_origen_2 = Point(legend_origen)

# ---- group: Cluster Input
angle_rotation_legend_degrees = ClusterInput()

# ----
legend_size_x_2 = Number(legend_size_x)
legend_size_y_2 = Number(legend_size_y)

# ---- group: Cluster Input
legend_offset = ClusterInput()

# ----
rectangle = Rectangle(Plane=legend_origen_2, XSize=legend_size_x_2, YSize=legend_size_y_2, Radius=0)  # -> Rectangle, Length
angle_rotation_legend_degrees_2 = Number(angle_rotation_legend_degrees)
legend_offset_2 = Number(legend_offset)
rotate = Rotate(Geometry=rectangle.Rectangle, Angle=degrees(angle_rotation_legend_degrees_2), Plane=legend_origen_2)  # -> Geometry, Transform
explode = Explode(Curve=rotate.Geometry, Recursive=True)  # -> Segments, Vertices
rectangle_frame = Curve(rotate.Geometry)
item = ListItem(List=explode.Segments, Index=Slider(2, range=0..10), Wrap=True)
offset = OffsetCurve(Curve=item, Distance=legend_offset_2, Plane=PlaneXY(0, 0, 0), Corners=1)

# ---- group: Cluster Output
rectangle_frame_2 = ClusterOutput(rectangle_frame)

# ----
eval = EvaluateCurve(Curve=reparameterize(offset), Parameter=Slider(1, range=0..1))  # -> Point, Tangent, Angle
xy = XYPlane(Origin=eval.Point)
rotate_2 = Rotate(Geometry=xy, Angle=degrees(angle_rotation_legend_degrees_2), Plane=eval.Point)  # -> Geometry, Transform
legend_title_plane = Geometry(rotate_2.Geometry)
legend_title_plane_2 = ClusterOutput(legend_title_plane)
