# Grasshopper definition mesh-image-sampler01.gh (Grasshopper 1.0.7)
# plug-ins: Docofossor, Bifocals

# ---- group: image_sampler
number_slider = Slider(1000, range=0..1000)
number_slider_2 = Slider(2000, range=0..10000)
rectangle = Rectangle(Plane=PlaneXY(0, 0, 0), XSize=number_slider, YSize=number_slider_2, Radius=0)  # -> Rectangle, Length
mplane = MeshPlane(Boundary=rectangle.Rectangle, WidthCount=number_slider, HeightCount=number_slider_2)  # -> Mesh, Area
facen = FaceNormals(Mesh=mplane.Mesh)  # -> Centers, Normals
image = ImageSampler(
    facen.Centers,
    FilePath="C:\users\klixto\Desktop\terrain_photoshop_grass.png",
    Filter="Value",
    Interpolate=False,
    Umax=1000,
    Umin=0,
    Vmax=2000,
    Vmin=0,
    Wrap=1)
panel = Panel(image)
smaller = SmallerThan(FirstNumber=image, SecondNumber=Slider(0.001, range=0..0.001))  # -> SmallerThan, OrEqualTo
cull = CullPattern(List=facen.Centers, CullPattern=smaller.SmallerThan)

# ---- group: Import Terrain Docofossor
path = FilePath("Z:\home\klixto\archives\onedrive\uniAdelaide\workshop\DTM_Lessons_ASCII_01.asc")
dfimportasc = ImportASC(F=path)
dfgridshift = GridShift(Df=dfimportasc)
dfgridmesh = GridMesh(Df=dfgridshift)
preview = CustomPreview(Geometry=dfgridmesh, Material=ColourSwatch(SwatchColor=RGB(31, 30, 29)))

# ---- group: Planting
lng = ListLength(List=cull)
subtraction = Subtraction(A=lng, B=Slider(3000, range=0..10000))
reduce = RandomReduce(List=cull, Reduction=subtraction, Seed=Slider(50, range=0..100))
Z = UnitZ(Factor=1)
meshray = MeshRay(Mesh=dfgridmesh, Point=reduce, Direction=Z)  # -> Point, Hit
dom = ConstructDomain(DomainStart=Slider(3, range=0..10), DomainEnd=Slider(8, range=0..10))
lng_2 = ListLength(List=meshray.Point)
Z_2 = UnitZ(Factor=1)
random = Random(Range=dom, Number=lng_2, Seed=2)
line = LineSDL(Start=meshray.Point, Direction=Z_2, Length=random)
number_slider_3 = Slider(3, range=0..10)
end = EndPoints(Curve=line)  # -> Start, End
division = Division(A=random, B=Slider(2, range=0..10))
msphere = MeshSphere(Base=end.End, Radius=division, UCount=number_slider_3, VCount=number_slider_3)
preview_2 = CustomPreview(Geometry=msphere, Material=ColourSwatch(SwatchColor=RGB(106, 255, 69)))
